# Grasshopper definition Snitch.gh (Grasshopper 1.0.7)
# plug-ins: Grasshopper-Tekla Link 2021.1.12, jSwan, Wombat, Heteroptera, SnitchGrasshopper, Kangaroo2 Components, Pufferfish

mo = ModelObject(
    [null x570],
    ModelID="Snitch.db1",
    ModelObjectInfos=["Tekla.Structures.Model.Component, Tekla.Structures.Model, Version=2021.0.0.0, Culture=neutral, PublicKeyToken=2f04dbe497b71114;23c1c803-20a4-4f5c-906d-7144a720750a", "Tekla.Structures.Model.Component, Tekla.Structures.Model, Version=2021.0.0.0, Culture=neutral, PublicKeyToken=2f04dbe497b71114;797283ab-cb0b-40f2-a92d-c367caf82e08", "Tekla.Structures.Model.Component, Tekla.Structures.Model, Version=2021.0.0.0, Culture=neutral, PublicKeyToken=2f04dbe497b71114;3ba01d2c-8979-4369-b5e8-7a83d6d0e57d", "Tekla.Structures.Model.Component, Tekla.Structures.Model, Version=2021.0.0.0, Culture=neutral, PublicKeyToken=2f04dbe497b71114;b9b98a8b-4178-4ebf-9aed-6ca20428b3b7", "Tekla.Structures.Model.Component, Tekla.Structures.Model, Version=2021.0.0.0, Culture=neutral, PublicKeyToken=2f04dbe497b71114;a6069cde-b487-43a4-b7db-a574d1e2c3b3", "Tekla.Structures.Model.Component, Tekla.Structures.Model, Version=2021.0.0.0, Culture=neutral, PublicKeyToken=2f04dbe497b71114;7ee1c311-1f17-4f20-8a96-6ebcf613e6be"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])
mo_2 = ModelObject(simplify(graft(mo)))
deassembly = DeconstructAssembly(Assembly=mo_2)  # -> Name, Type, MainPart, Secondaries, AllObjects
pshift = ShiftPaths(Data=deassembly.AllObjects, Offset=-1)
clean = CleanTree(RemoveNulls=True, RemoveInvalid=True, RemoveEmpty=True, Tree=pshift)
cull_i = CullIndex(List=clean, Indices="0", Wrap=True)
item = ListItem(List=clean, Index="0", Wrap=True)

# ---- group: Rebars
rbr = Rebar(cull_i)
pshift_2 = ShiftPaths(Data=rbr, Offset=-1)
prop = GetProperty(TeklaObject=pshift_2, Name="WEIGHT", Type=0)
pshift_3 = ShiftPaths(Data=prop, Offset=-1)
ma = MassAddition(Input=pshift_3)  # -> Result, PartialResults

# ---- group: Beam and columns
beam = Beam(item)
clean_2 = CleanTree(RemoveNulls=True, RemoveInvalid=True, RemoveEmpty=True, Tree=beam)
debeam = DeconstructBeam(Beam=clean_2)  # -> Curve, Profile, Attributes, Position, Numbering, Deforming, Type
mesh = ConvertToMesh(TeklaObject=clean_2, SolidType=2)
expattributes = ExpandPartAttributes(Attributes=debeam.Attributes)  # -> Name, Profile, Material, Finish, Class, Phase, UDA
cp = ControlPoints(Curve=debeam.Curve)  # -> Points, Weights, Knots
pshift_4 = ShiftPaths(Data=mesh, Offset=-1)
pshift_5 = ShiftPaths(Data=cp.Points, Offset=-1)
tmatch = MatchText(Text=debeam.Type, Pattern="BEAM", Case=True)
tmatch_2 = MatchText(Text=debeam.Type, Pattern="COLUMN", Case=True)
volume = Volume(Geometry=pshift_4)  # -> Volume, Centroid
dispatch = Dispatch(List=debeam.Curve, DispatchPattern=tmatch)  # -> ListA, ListB
tstat = TreeStatistics(Tree=dispatch.ListA)  # -> Paths, Length, Count
dispatch_2 = Dispatch(List=volume.Volume, DispatchPattern=tmatch_2)  # -> ListA, ListB
dispatch_3 = Dispatch(List=expattributes.Material, DispatchPattern=tmatch_2)  # -> ListA, ListB
dispatch_4 = Dispatch(List=pshift_4, DispatchPattern=tmatch)  # -> ListA, ListB
dispatch_5 = Dispatch(List=debeam.Curve, DispatchPattern=tmatch_2)  # -> ListA, ListB
tstat_2 = TreeStatistics(Tree=dispatch_5.ListA)  # -> Paths, Length, Count
branch = TreeBranch(Tree=ma.Result, Path=tstat_2.Paths, MaintainPaths=True)
dispatch_6 = Dispatch(List=pshift_4, DispatchPattern=tmatch_2)  # -> ListA, ListB
dispatch_7 = Dispatch(List=volume.Volume, DispatchPattern=tmatch_2)  # -> ListA, ListB
dispatch_8 = Dispatch(List=volume.Volume, DispatchPattern=tmatch)  # -> ListA, ListB
branch_2 = TreeBranch(Tree=ma.Result, Path=tstat.Paths, MaintainPaths=True)
dispatch_9 = Dispatch(List=expattributes.Material, DispatchPattern=tmatch)  # -> ListA, ListB
dispatch_10 = Dispatch(List=volume.Volume, DispatchPattern=tmatch)  # -> ListA, ListB
panel = Panel("50")
snitch_beam = SnitchBeam(
    Mesh=dispatch_4.ListA,
    Polyline=dispatch.ListA,
    ConcreteVolume=dispatch_8.ListA,
    SteelMass=branch_2,
    ConcreteClass=dispatch_9.ListA,
    Load="40")

# ----
panel_2 = Panel(debeam.Curve)
long = LongestList(ListA=dispatch_6.ListA, ListB=panel, PaddingMode=2)  # -> ListA, flatten(ListB)
randomize = RandomizeNumbers(Number=long.ListB, Ratio=0.2)
unflatten = UnflattenTree(Tree=randomize, Guide=long.ListA)
snitch_column = SnitchColumn(
    Mesh=dispatch_6.ListA,
    Polyline=dispatch_5.ListA,
    ConcreteVolume=dispatch_7.ListA,
    SteelMass=branch,
    ConcreteClass=dispatch_3.ListA)
panel_3 = Panel(unflatten)
panel_4 = Panel(snitch_column)

# ---- group: Slabs
plt = Plate(item)
clean_3 = CleanTree(RemoveNulls=True, RemoveInvalid=True, RemoveEmpty=True, Tree=plt)
deplate = DeconstructPlate(Plate=clean_3)  # -> Boundary, Profile, Attributes, Position, Numbering, Type
mesh_2 = ConvertToMesh(TeklaObject=clean_3, SolidType=2)
expattributes_2 = ExpandPartAttributes(Attributes=deplate.Attributes)  # -> Name, Profile, Material, Finish, Class, Phase, UDA
cp_2 = ControlPoints(Curve=deplate.Boundary)  # -> Points, Weights, Knots
pshift_6 = ShiftPaths(Data=mesh_2, Offset=-1)
panel_5 = Panel("PLATE")
pshift_7 = ShiftPaths(Data=cp_2.Points, Offset=-1)
volume_2 = Volume(Geometry=pshift_6)  # -> Volume, Centroid
panel_6 = Panel("1")
tstat_3 = TreeStatistics(Tree=volume_2.Volume)  # -> Paths, Length, Count
branch_3 = TreeBranch(Tree=ma.Result, Path=tstat_3.Paths, MaintainPaths=True)

# ---- group: Voronoi
crv = Curve(deplate.Boundary)
end = EndPoints(Curve=debeam.Curve)  # -> Start, End
c_script = CSharpScript(curves=flatten(crv))  # -> graft(A); inputs curves: list of Curve
# ---------- c_script: C# ----------
    List<helper> newCurves = new List<helper>();
    
    foreach (var curve in curves)
    {
      Plane normal;
      curve.TryGetPlane(out normal, 0.001);
      if (normal.ZAxis.Z > 0.9)
      {
        newCurves.Add(new helper(){curve = curve, Ele = normal.Origin.Z});
      }
       
    }
    newCurves.Sort((x,y) => x.Ele.CompareTo(y.Ele));
    List<Curve> final = new List<Curve>();
    foreach (var item in newCurves)
    {
      final.Add(item.curve);
    }
    A = final;
# ---------- c_script: C# additional code ----------
  public class helper
  {
    public double Ele {get;set;}
    public Curve curve {get;set;}
  }
# ---------- end c_script ----------
boundary = BoundarySurfaces(Edges=c_script)
duppt = RemoveDuplicatePts(Points=flatten([end.Start, end.End]), Tolerance=0.01)
brep_cp = BrepClosestPoint(Point=duppt, Brep=boundary)  # -> Point, Normal, Distance
equals = Equality(FirstNumber=simplify(brep_cp.Point), SecondNumber=2)  # -> Equality, Inequality
smaller = SmallerThan(FirstNumber=brep_cp.Distance, SecondNumber="10")  # -> SmallerThan, OrEqualTo
cull = CullPattern(List=duppt, CullPattern=smaller.SmallerThan)  # -> simplify(List)
voronoi = Voronoi(Points=cull, BruteForceOverride=False)
merge = Merge(Data1=simplify(c_script), Data2=simplify(voronoi))
planar = IsPlanar(Surface=boundary, Interior=True)  # -> Planar, Plane
panel_7 = Panel(cull)
rint = RegionIntersection(CurvesA=simplify(c_script), CurvesB=simplify(voronoi), Plane=planar.Plane)
runion = RegionUnion(Curves=merge)
trim = TrimWithRegion(Curve=simplify(voronoi), Region=simplify(c_script))  # -> Inside, Outside
pshift_8 = ShiftPaths(Data=trim.Inside, Offset=-1)
crv_2 = Curve(pshift_8)
clscrv = CloseCurve(Curve=crv_2, CloseType=0, Bulge=0.5, Tolerance=0)  # -> Closed, R

# ----
long_2 = LongestList(ListA=branch_3, ListB="2", PaddingMode=2)  # -> ListA, flatten(ListB)
randomize_2 = RandomizeNumbers(Number=long_2.ListB, Ratio=0.2)
unflatten_2 = UnflattenTree(Tree=randomize_2, Guide=long_2.ListA)

# ---- group: Slabs (continued)
snitch_slab = SnitchSlab(
    Mesh=pshift_6,
    Polyline=deplate.Boundary,
    ConcreteVolume=volume_2.Volume,
    SteelMass=branch_3,
    ConcreteClass=expattributes_2.Material,
    Thickness=expattributes_2.Profile,
    Load=unflatten_2)

# ----
merge_2 = Merge(Data1=snitch_beam, Data2=snitch_column, Data3=snitch_slab)  # -> flatten(Result)
snitch_building = SnitchBuilding(ListOfBuildingObjects=merge_2, Voronois=clscrv.Closed)

# ---- group: Create JSON database
snitchobject = Data(snitch_building)
rejson = SerializeJson(SnitchObject=snitchobject, IncludeNullAndEmptyProperties=False)  # disabled
rejson_2 = SerializeJson(Building=snitchobject, IncludeNullAndEmptyProperties=False)
c_script_2 = CSharpScript()  # -> CurrentFolder
# ---------- c_script_2: C# usings ----------
using System.IO;
# ---------- c_script_2: C# ----------
    CurrentFolder = Path.GetDirectoryName(GrasshopperDocument.FilePath) + Path.DirectorySeparatorChar;
# ---------- end c_script_2 ----------
create_json = BooleanToggle(False)
join = TextJoin(Text=rejson, Join=",")
dejson = DeserializeJson(JSON=rejson_2, OutputsLocked=False)
concat = Concatenate(FragmentA=c_script_2, FragmentB="Database3.json")
concat_2 = Concatenate(FragmentA="[", FragmentB=join, FragmentC="]")
writetxt = WriteToTextFile(Run=create_json, TextToWrite=dejson, FilePath=concat, Append=Toggle(False), NewOnly=False)
panel_8 = Panel(writetxt)
